# Grasshopper definition Bark beetle SLA print - Slicer.gh (Grasshopper 0.9.76)
# plug-ins: Weaverbird

pt = ConstructPoint(XCoordinate=Slider(70, range=0..100), YCoordinate=0, ZCoordinate=0)
strut_radius = Slider(0.617, range=0..1)
disc_radius = Slider(2, range=0..10)
disc_length = Slider(0.4, range=0..10)
flex_ratio = Slider(0.087, range=0..1)
cell_size = Slider(10, range=0..10)
xy = XYPlane(Origin=pt)
trigrid = Triangular(Plane=xy, Size=cell_size, ExtentX=Slider(6, range=0..10), ExtentY=Slider(4, range=0..10))  # -> Cells, Points
bbox = BoundingBox(Content=flatten(trigrid.Cells), Plane=PlaneXY(0, 0, 0), UnionBox=True)  # -> Box, Box_2
area = Area(Geometry=bbox.Box)  # -> Area, Centroid
multiplication = Multiplication(A=pt, B=flex_ratio)
vec2pt = Vector2Pt(PointA=area.Centroid, PointB=pt, Unitize=False)  # -> Vector, Length
move = Move(Geometry=trigrid.Points, Motion=vec2pt.Vector)  # -> Geometry, Transform
move_2 = Move(Geometry=trigrid.Cells, Motion=vec2pt.Vector)  # -> Geometry, Transform
Z = UnitZ(Factor=multiplication)
explode = Explode(Curve=move_2.Geometry, Recursive=True)  # -> Segments, Vertices
move_3 = Move(Geometry=move.Geometry, Motion=Z)  # -> Geometry, Transform
neg = Negative(Value=strut_radius)
pln = Plane(xy)
Z_2 = UnitZ(Factor=neg)
eval = EvaluateLength(Curve=explode.Segments, Length=Slider(0.5, range=0..1), Normalized=True)  # -> Point, Tangent, Parameter
ln = Line(StartPoint=eval.Point, EndPoint=graft(move_3.Geometry))
xy_2 = XYPlane(Origin=eval.Point)
cyl = Cylinder(Base=pln, Radius=disc_radius, Length=disc_length)
cap = CapHoles(Brep=cyl)
move_4 = Move(Geometry=cap, Motion=Z_2)  # -> Geometry, Transform
orient = Orient(Geometry=move_4.Geometry, Source=pln, Target=xy_2)  # -> Geometry, Transform
pipe = Pipe(Curve=ln, Radius=strut_radius, Caps=2)
brep = Brep([orient.Geometry, pipe])

number_slider = Slider(5, range=0..10)
X = UnitX(Factor=Slider(80, range=0..100))
mbox = MeshBox(
    Base={Plane=PlaneXY(0, 0, 0), X=Domain(-10, 10), Y=Domain(-10, 10), Z=Domain(-10, 10)},
    XCount=number_slider,
    YCount=number_slider,
    ZCount=number_slider)
move_5 = Move(Geometry=mbox, Motion=X)  # -> Geometry, Transform
wbcarpet = WeaverbirdsSierpinskiCarpet(MeshPolylines=move_5.Geometry, Distance=Slider(16, range=0..100), InsetType=0)
wbthicken = WeaverbirdsMeshThicken(MeshCurves=wbcarpet, Distance=Slider(1.179, range=0..5), OffsetType=0)
wbsplitquads = WeaverbirdsConstantQuadsSplitSubdivision(MeshCurves=wbthicken, Level=Slider(1, range=0..10), SmoothNakedEdges=1)
wbloop = WeaverbirdsLoopSubdivision(MeshCurves=wbsplitquads, Level=Slider(1, range=0..10), SmoothNakedEdges=1)

# ---- group: Make fancy holes in mesh surface
custom_mesh_settings = SettingsCustom(
    StitchSeams=True,
    SimplePlanes=False,
    Refine=True,
    MinCount=16,
    MaxCount=400,
    AspectRatio=20,
    MaxDistance=0,
    MaxAngle=60,
    MinEdge=Slider(2, range=0..2),
    MaxEdge=0)
brep_2 = Brep(<brep referenced from the Rhino model>)
mesh = MeshBrep(Brep=brep_2, Settings=custom_mesh_settings)  # disabled
tri = Triangulate(Mesh=mesh)  # -> Mesh, Count
wbframe = WeaverbirdsPictureFrame(MeshPolylines=tri.Mesh, Distance=Slider(12, range=0..100), InsetType=0)
wbthicken_2 = WeaverbirdsMeshThicken(MeshCurves=wbframe, Distance=Slider(0.8, range=0..1), OffsetType=0)
wbcatmullclark = WeaverbirdsCatmullClarkSubdivision(MeshCurves=wbthicken_2, Level=1, SmoothNakedEdges=1)
mesh_2 = Mesh(wbcatmullclark)

# ----
smooth = SettingsQuality()
mesh_3 = MeshBrep(Brep=brep_2, Settings=smooth)
support_bottom_diameter = Slider(4, range=0..10)
support_top_diameter = Slider(0.6, range=0..10)
support_spacing = Slider(0.8, range=0..10)
make_hollow_shells_from_double_lines = BooleanToggle(True)
make_hollow_shells_by_offset = BooleanToggle(False)
slice_resolution = Slider(0.1, range=0.1..5)
generate_support = BooleanToggle(True)
support_spacing_2 = Panel(support_spacing)
custom_mesh_settings_2 = SettingsCustom(
    StitchSeams=True,
    SimplePlanes=False,
    Refine=True,
    MinCount=16,
    MaxCount=400,
    AspectRatio=20,
    MaxDistance=0,
    MaxAngle=20,
    MinEdge=Slider(0.4, range=0..1),
    MaxEdge=0)
support_bottom_diameter_2 = Panel(support_bottom_diameter)
support_top_diameter_2 = Panel(support_top_diameter)
smooth_2 = SettingsQuality()
brep_3 = Brep(<brep referenced from the Rhino model>)
mesh_4 = Mesh()
mesh_5 = Mesh(<mesh referenced from the Rhino model>)
mesh_6 = Mesh(wbloop)
mesh_7 = MeshBrep(Brep=brep_3, Settings=custom_mesh_settings_2)
geometry_for_print = Geometry(mesh_7)
gate = StreamGate(Stream=geometry_for_print, Gate=generate_support)  # -> Target0, Target1
mesh_for_support = Mesh(gate.Target1)
bbox_2 = BoundingBox(Content=mesh_for_support, Plane=PlaneXY(0, 0, 0))  # -> Box, Box_2
debrep = DeconstructBrep(Brep=bbox_2.Box)  # -> Faces, Edges, Vertices
support_spacing_3 = Panel(support_spacing_2)
support_bottom_diameter_3 = Panel(support_bottom_diameter_2)
support_top_diameter_3 = Panel(support_top_diameter_2)
item = ListItem(List=debrep.Faces, Index=Slider(4, range=0..10), Wrap=True)
addition = Addition(A=support_bottom_diameter_3, B=support_spacing_3)
dim = Dimensions(Surface=item)  # -> UDimension, VDimension
xy_3 = XYPlane(Origin=Point(0, 0, 0))
division = Division(A=dim.UDimension, B=addition)
division_2 = Division(A=dim.VDimension, B=addition)
pln_2 = Plane(xy_3)
mesh_8 = Mesh(mesh_for_support)
int = Integer(division)
int_2 = Integer(division_2)
multiplication_2 = Multiplication(A=support_bottom_diameter_3, B=Slider(0.5, range=0..1))
multiplication_3 = Multiplication(A=support_top_diameter_3, B=Slider(0.5, range=0..1))
mshadow = MeshShadow(Mesh=mesh_8, Light=Vector(0, 0, -1), Plane=pln_2)
runion = RegionUnion(Curves=flatten(mshadow))
sdivide = DivideSurface(Surface=item, UCount=int, VCount=int_2)  # -> Points, Normals, Parameters
lng = ListLength(List=runion)
smaller = SmallerThan(FirstNumber=lng, SecondNumber=Slider(1, range=0..1))  # -> SmallerThan, OrEqualTo
project = Project(Geometry=sdivide.Points, Plane=pln_2)  # -> Geometry, Transform
filter = StreamFilter(Gate=smaller.SmallerThan, Stream0=runion, Stream1=mshadow)
incurve = PointInCurve(Point=flatten(project.Geometry), Curve=filter)  # -> Relationship, Point
dispatch = Dispatch(List=flatten(project.Geometry), DispatchPattern=incurve.Relationship)  # -> ListA, ListB
pt_2 = Point(dispatch.ListA)
mesh_9 = Mesh(mesh_for_support)
xy_4 = XYPlane(Origin=Point(0, 0, 0))
meshcp = MeshClosestPoint(Point=pt_2, Mesh=mesh_9)  # -> Point, Index, Parameter
pln_3 = Plane(xy_4)
project_2 = Project(Geometry=meshcp.Point, Plane=pln_3)  # -> Geometry, Transform
support_cutoff_threshold = Slider(50, range=0..100)
vec2pt_2 = Vector2Pt(PointA=pt_2, PointB=project_2.Geometry, Unitize=False)  # -> Vector, Length
vec2pt_3 = Vector2Pt(PointA=pt_2, PointB=meshcp.Point, Unitize=False)  # -> Vector, Length
angle = Angle(VectorA=vec2pt_2.Vector, VectorB=vec2pt_3.Vector)  # -> Angle, Reflex
deg = Degrees(Radians=angle.Angle)
smaller_2 = SmallerThan(FirstNumber=deg, SecondNumber=support_cutoff_threshold)  # -> SmallerThan, OrEqualTo
dispatch_2 = Dispatch(List=meshcp.Point, DispatchPattern=smaller_2.SmallerThan)  # -> ListA, ListB
dispatch_3 = Dispatch(List=pt_2, DispatchPattern=smaller_2.SmallerThan)  # -> ListA, ListB
pt_3 = Point(dispatch_3.ListB)
pt_4 = Point(dispatch_2.ListB)
xy_5 = XYPlane(Origin=pt_3)
xy_6 = XYPlane(Origin=pt_4)
cir = Circle(Plane=xy_6, Radius=multiplication_3)
cir_2 = Circle(Plane=xy_5, Radius=multiplication_2)
graft = GraftTree(Tree=flatten(cir), IncludeEmptyLists=True, IncludeNullItems=True)
graft_2 = GraftTree(Tree=flatten(cir_2), IncludeEmptyLists=True, IncludeNullItems=True)
loft = Loft(
    Curves=[graft, graft_2],
    Options={Adjust=False, Closed=False, LoftEnds=0, LoftSimp=0, LoftType=0, Rebuild=10, Refit=0.01})
custom_mesh_settings_3 = SettingsCustom(
    StitchSeams=True,
    SimplePlanes=False,
    Refine=True,
    MinCount=16,
    MaxCount=400,
    AspectRatio=20,
    MaxDistance=0,
    MaxAngle=20,
    MinEdge=Slider(0.6, range=0..1),
    MaxEdge=0)
mesh_10 = MeshBrep(Brep=loft, Settings=custom_mesh_settings_3)
support_meshes = Mesh(flatten(mesh_10))
merge = Merge(Data1=geometry_for_print, Data2=support_meshes)
geo = Geometry(merge)
flatten = FlattenTree(Tree=geo, Path="{0}")
bbox_3 = BoundingBox(Content=flatten(flatten), Plane=PlaneXY(0, 0, 0), UnionBox=True)  # -> Box, Box_2
debrep_2 = DeconstructBrep(Brep=bbox_3.Box)  # -> Faces, Edges, Vertices
item_2 = ListItem(List=debrep_2.Faces, Index=Slider(4, range=0..10), Wrap=True)
item_3 = ListItem(List=debrep_2.Faces, Index=0, Wrap=True)
dim_2 = Dimensions(Surface=item_2)  # -> UDimension, VDimension
dim_3 = Dimensions(Surface=item_3)  # -> UDimension, VDimension
division_3 = Division(A=dim_3.VDimension, B=slice_resolution)
round = Round(Number=division_3)  # -> Nearest, Floor, Ceiling
number_of_slices = Number(round.Ceiling)
area_2 = Area(Geometry=item_2)  # -> Area, Centroid
series = Series(Start=0, Step=slice_resolution, Count=number_of_slices)
Z_3 = UnitZ(Factor=series)
xy_7 = XYPlane(Origin=area_2.Centroid)
geometry_for_print_2 = Geometry(flatten)
move_6 = Move(Geometry=xy_7, Motion=Z_3)  # -> Geometry, Transform
sec = MeshPlane(Mesh=geometry_for_print_2, Plane=graft(move_6.Geometry))
pshift = ShiftPaths(Data=sec, Offset=-1)
flip = FlipMatrix(Data=pshift)
gate_2 = StreamGate(Stream=flip, Gate=make_hollow_shells_from_double_lines)  # -> Target0, Target1
flip_2 = FlipMatrix(Data=gate_2.Target1)
clean = CleanTree(RemoveNulls=True, RemoveInvalid=True, RemoveEmpty=True, Tree=flip_2)
boundary = BoundarySurfaces(Edges=gate_2.Target0)
boundary_2 = BoundarySurfaces(Edges=flip_2)
filter_2 = StreamFilter(Gate=make_hollow_shells_from_double_lines, Stream0=boundary, Stream1=boundary_2)
surface_slices = Surface(filter_2)
mesh_11 = MeshBrep(
    Brep=surface_slices,
    Settings={GridMaxCount=0, GridMinCount=16, JaggedSeams=False, MaxEdgeLength=0, MinEdgeLength=0.0001, MinTolerance=0, Refine=True, RefineAngle=0, RelativeTolerance=0.65, SimplePlanes=True, Tolerance=0})
geo_2 = Geometry(mesh_11)
