# Grasshopper definition Bark beetle SLA print - Slide viewer and machine control.gh (Grasshopper 0.9.76)
# plug-ins: Firefly.X, setFlounderCamera, Firefly.Core

number_slider = Slider(8, range=0..10)
timer = Timer(TimerInterval=20, Target=uno_read)
ports_available = COMPortsAvailable()
open_port = OpenClosePort(OpenClosePort=Toggle(True), PortNumber=number_slider, BaudRate=115200)
uno_read = UnoRead(StartReadingValues=Toggle(True), PortNumber=number_slider)  # -> AnalogPin0, AnalogPin1, AnalogPin2, AnalogPin3, AnalogPin4, AnalogPin5, DigitalPin2, DigitalPin4, DigitalPin7, StatusMessage
panel = Panel(ports_available)
panel_2 = Panel(open_port)
panel_3 = Panel(uno_read.AnalogPin0)
panel_4 = Panel(uno_read.StatusMessage)
larger = LargerThan(FirstNumber=panel_3, SecondNumber=Slider(640, range=0..1000))  # -> LargerThan, OrEqualTo
panel_5 = Panel(larger.LargerThan)
blink = BinaryBlink(BlinkPattern=Slider(1000, range=0..1000), Start=Toggle(False), Repeat=True)
panel_6 = Panel(blink)
display_calibration_curves = BooleanToggle(False)
calibation_curves = Curve([<curve referenced from the Rhino model> x10])
reduced_exposure_from_this_slice_number = Slider(41, range=0..100)
build_chamber_size_x = Slider(50, range=0..100)
build_chamber_size_y = Slider(50, range=0..100)
build_slice_and_3d_preview_spacing = Slider(16, range=0..100)
platform_down_safety_delay_time = Slider(1, range=0..10)
platform_up_safety_delay_time = Slider(3, range=1..10)
slice_fill_light_intensity_reduction = Slider(0.35, range=0..1)
slice_fill_light_intensity_reduction_2 = Slider(0.4, range=0..1)
camera_position_tune_y = Slider(43.2, range=-50..50)
camera_position_tune_z = Slider(171.7, range=50..300)
camera_position_tune_x = Slider(13.4, range=-100..100)
output_port_slice_trigger = Slider(6, range=0..10)
finished_print_end_height = Slider(8, range=0..10)
_3d_preview_display_angle = Slider(15, range=0..100)
start_slice_exposuretime = Slider(10, range=1..20)
number_of_start_slices = Slider(4, range=0..40)
camera_position_tune_x_2 = Slider(-37.1, range=-200..200)
camera_position_tune_z_2 = Slider(155.2, range=50..300)
camera_viewport_name = Panel("Bark beetle SLA")
camera_position_tune_y_2 = Slider(0, range=-200..200)
slice_exposuretime = Slider(4, range=1..20)
manual_slice_preview = Slider(0.685, range=0..1)
move_speed_z = Slider(15, range=0..100)
enable_manual_slice_control = BooleanToggle(False)
enable_camera = BooleanToggle(True)
camera_viewport_name_2 = Panel("Bark beetle SLA")
camera_viewport_name_3 = Panel("Perspective")
layer_height = Slider(0.1, range=0..1)
dip_depth = Slider(4, range=0..5)
enable_shopbot_control = BooleanToggle(True)
enable_camera_2 = BooleanToggle(True)
expose_slice_edges = BooleanToggle(True)
crv = Curve([<curve referenced from the Rhino model> x23])  # disabled
reset_count_values = BooleanToggle(False)
test_state_button = Button()
shopbot_output_state = Panel(panel_5)
filter = StreamFilter(Gate=display_calibration_curves, Stream1=calibation_curves)
pipeline = GeometryPipeline(
    GroupByLayer=False,
    GroupByType=False,
    IncludeHidden=True,
    IncludeLocked=True,
    LayerFilter="Print slices",
    NameFilter="*",
    TypeFilter=32)
preview = CustomPreview(Geometry=filter, Shader=ColourSwatch(SwatchColor=RGB(33, 222, 255)))
filter_2 = StreamFilter(Gate=enable_shopbot_control, Stream0=test_state_button, Stream1=shopbot_output_state)
slice_fill_light_intensity_reduction_3 = Panel(slice_fill_light_intensity_reduction_2)
reduced_exposure_from_this_slice_number_2 = Panel(reduced_exposure_from_this_slice_number)
manual_slice_preview_2 = Panel(manual_slice_preview)
expose_slice_edges_2 = Panel(expose_slice_edges)
enable_manual_slice_control_2 = Panel(enable_manual_slice_control)
layer_height_2 = Panel(layer_height)
pt = ConstructPoint(XCoordinate=camera_position_tune_y, YCoordinate=camera_position_tune_x, ZCoordinate=camera_position_tune_z)
build_chamber_size_x_2 = Panel(build_chamber_size_x)
build_chamber_size_y_2 = Panel(build_chamber_size_y)
build_slice_and_3d_preview_spacing_2 = Panel(build_slice_and_3d_preview_spacing)
_3d_previe_display_angle = Panel(_3d_preview_display_angle)
pt_2 = ConstructPoint(XCoordinate=camera_position_tune_y, YCoordinate=camera_position_tune_x, ZCoordinate=0)
pt_3 = ConstructPoint(XCoordinate=camera_position_tune_x_2, YCoordinate=camera_position_tune_y_2, ZCoordinate=camera_position_tune_z_2)
pt_4 = ConstructPoint(XCoordinate=camera_position_tune_x_2, YCoordinate=camera_position_tune_y_2, ZCoordinate=0)
trigger_button_state = Number(filter_2)
lens_length = Slider(50, range=8..200)
camera_position_point = Point(pt)
camera_target_point = Point(pt_2)
lens_length_2 = Slider(28, range=8..200)
camera_position_point_2 = Point(pt_3)
camera_target_point_2 = Point(pt_4)
bang = Bang(BooleanInput=trigger_button_state)  # -> TrueState, FalseState
Y = UnitY(Factor=1)
int = Integer(lens_length)
counter = Counter(CountDirection=True, Step=1, StartStop=bang.TrueState, Reset=reset_count_values, OptionalCounterDomain=Domain(0, 0))
Y_2 = UnitY(Factor=1)
int_2 = Integer(lens_length_2)
syncfloundercamera = SyncFlounderCamera(
    Activate=enable_camera,
    ViewportName=camera_viewport_name,
    Location=camera_position_point,
    Target=camera_target_point,
    Lens=int,
    Up=Y)
int_3 = Integer(counter)
syncfloundercamera_2 = SyncFlounderCamera(
    Activate=enable_camera_2,
    ViewportName=camera_viewport_name_3,
    Location=camera_position_point_2,
    Target=camera_target_point_2,
    Lens=int_2,
    Up=Y_2)
current_layer = Panel(int_3)

# ---- group: Identfly number of layers
bbox = BoundingBox(Content=pipeline, Plane=PlaneXY(0, 0, 0))  # -> Box, Box_2
debrep = DeconstructBrep(Brep=bbox.Box)  # -> Faces, Edges, Vertices
item = ListItem(List=debrep.Vertices, Index=0, Wrap=True)
pdecon = Deconstruct(Point=item)  # -> XComponent, YComponent, ZComponent
flatten = FlattenTree(Tree=pdecon.ZComponent, Path="{0}")
flatten_2 = FlattenTree(Tree=pipeline, Path="{0}")
sort = SortList(Keys=flatten, ValuesA=flatten_2)  # -> Keys, ValuesA
rev = ReverseList(List=sort.Keys)
layer_height_3 = Panel(layer_height_2)
item_2 = ListItem(List=rev, Index=0, Wrap=True)
division = Division(A=item_2, B=layer_height_3)
addition = Addition(A=division, B=Slider(1, range=0..1))
int_4 = Integer(addition)
number_of_layers = Panel(int_4)

# ----
enable_manual_slice_control_3 = Panel(enable_manual_slice_control_2)
number_of_layers_2 = Panel(number_of_layers)
multiplication = Multiplication(A=manual_slice_preview_2, B=number_of_layers_2)
filter_3 = StreamFilter(Gate=enable_manual_slice_control_3, Stream0=current_layer, Stream1=multiplication)

# ---- group: Sort objects by slice layer
division_2 = Division(A=Slider(1, range=0..1), B=layer_height_2)
series = Series(Start=0, Step=1, Count=number_of_layers)
multiplication_2 = Multiplication(A=sort.Keys, B=division_2)
int_5 = Integer(series)
round = Round(Number=multiplication_2)  # -> Nearest, Floor, Ceiling
graft = GraftTree(Tree=int_5, IncludeEmptyLists=True, IncludeNullItems=True)
mindex = MemberIndex(Set=round.Nearest, Member=graft)  # -> Index, Count
flatten_3 = FlattenTree(Tree=mindex.Count, Path="{0}")
panel_7 = Panel(flatten_3)
partition = PartitionList(List=sort.ValuesA, Size=panel_7)
flip = FlipMatrix(Data=partition)

# ---- group: Find center point of sliced object
bbox_2 = BoundingBox(Content=pipeline, Plane=PlaneXY(0, 0, 0), UnionBox=True)  # -> Box, Box_2
debrep_2 = DeconstructBrep(Brep=bbox_2.Box)  # -> Faces, Edges, Vertices
item_3 = ListItem(List=debrep_2.Faces, Index=Slider(4, range=0..10), Wrap=True)
area = Area(Geometry=item_3)  # -> Area, Centroid
xy = XYPlane(Origin=area.Centroid)

# ---- group: Generate planes for slice orientation
number_of_layers_3 = Panel(number_of_layers)
layer_height_4 = Panel(layer_height_2)
series_2 = Series(Start=0, Step=layer_height_4, Count=number_of_layers_3)
Z = UnitZ(Factor=series_2)
move = Move(Geometry=xy, Motion=Z)  # -> Geometry, Transform
pln = Plane(move.Geometry)

# ----
number_of_layers_4 = Panel(number_of_layers)
neg = Negative(Value=layer_height_2)
neg_2 = Negative(Value=dip_depth)
series_3 = Series(Start=neg_2, Step=neg, Count=number_of_layers_4)
series_4 = Series(Start=0, Step=neg, Count=number_of_layers_4)
number_of_start_slices_2 = Number(number_of_start_slices)
pause = Text("Pause")
pause_2 = Text("Pause")
z_platform_move_heights = Number(series_3)
pause_3 = Text("Pause")
so = Text("SO")
mz = Text("MZ")
mz_2 = Text("MZ")
z_print_heights = Number(series_4)
platform_up_safety_delay_time_2 = Number(platform_up_safety_delay_time)
dup = DuplicateData(Data=mz, Number=flatten(number_of_layers_4), Order=True)
num = Number(move_speed_z)
dup_2 = DuplicateData(Data=mz_2, Number=flatten(number_of_layers_4), Order=True)
ms = Text("MS")
graft_2 = GraftTree(Tree=flatten(dup), IncludeEmptyLists=True, IncludeNullItems=True)
graft_3 = GraftTree(Tree=flatten(z_platform_move_heights), IncludeEmptyLists=True, IncludeNullItems=True)
subtraction = Subtraction(A=number_of_layers_4, B=number_of_start_slices_2)
graft_4 = GraftTree(Tree=flatten(dup_2), IncludeEmptyLists=True, IncludeNullItems=True)
graft_5 = GraftTree(Tree=flatten(z_print_heights), IncludeEmptyLists=True, IncludeNullItems=True)
end_height = Number(finished_print_end_height)
mz_3 = Text("MZ")
text = Text(",")
space = Text(" ")
int_6 = Integer(platform_up_safety_delay_time_2)
pause_4 = Text("Pause")
int_7 = Integer(slice_exposuretime)
space_2 = Text(" ")
int_8 = Integer(start_slice_exposuretime)
text_2 = Text(",")
text_3 = Text(",")
space_3 = Text(" ")
int_9 = Integer(output_port_slice_trigger)
int_10 = Integer(platform_down_safety_delay_time)
int_11 = Integer(output_port_slice_trigger)
int_12 = Integer(Slider(0, range=0..1))
space_4 = Text(" ")
int_13 = Integer(Slider(1, range=0..1))
text_4 = Text(",")
text_5 = Text(",")
text_6 = Text(",")
join = TextJoin(Text=[pause_4, space, int_6])
join_2 = TextJoin(Text=[mz_3, end_height], Join=text)
join_3 = TextJoin(Text=[pause, space_3, int_8])
join_4 = TextJoin(Text=[pause_2, space_2, int_7])
join_5 = TextJoin(Text=[graft_2, graft_3], Join=text_4)
join_6 = TextJoin(Text=[so, int_9, int_12], Join=text_2)
join_7 = TextJoin(Text=[so, int_11, int_13], Join=text_3)
join_8 = TextJoin(Text=[pause_3, space_4, int_10])
join_9 = TextJoin(Text=[graft_4, graft_5], Join=text_5)
join_10 = TextJoin(Text=[ms, move_speed_z, num], Join=text_6)
dup_3 = DuplicateData(Data=join, Number=flatten(number_of_layers_4), Order=True)
dup_4 = DuplicateData(Data=join_4, Number=flatten(subtraction), Order=True)
dup_5 = DuplicateData(Data=join_7, Number=flatten(number_of_layers_4), Order=True)
item_4 = ListItem(List=flatten(join_5), Index=0, Wrap=True)
dup_6 = DuplicateData(Data=join_6, Number=flatten(number_of_layers_4), Order=True)
dup_7 = DuplicateData(Data=join_3, Number=flatten(number_of_start_slices_2), Order=True)
dup_8 = DuplicateData(Data=join_8, Number=flatten(number_of_layers_4), Order=True)
merge = Merge(Data1=flatten(dup_7), Data2=flatten(dup_4))
weave = Weave(
    Pattern=[0, 1, 2, 3, 4, 5, 6],
    Stream0=flatten(join_9),
    Stream1=flatten(dup_3),
    Stream2=flatten(dup_5),
    Stream3=flatten(merge),
    Stream4=flatten(dup_6),
    Stream5=flatten(dup_8),
    Stream6=flatten(join_5),
    NullGaps=False)
rev_2 = ReverseList(List=flatten(weave))
cull_i = CullIndex(List=rev_2, Indices=0, Wrap=True)
rev_3 = ReverseList(List=flatten(cull_i))
merge_2 = Merge(Data1=flatten(join_10), Data2=flatten(item_4), Data3=rev_3, Data4=join_2)
panel_8 = Panel(merge_2)

number_of_layers_5 = Panel(number_of_layers)
current_slice_layer = Panel(filter_3)

# ---- group: Create shader materials for print slice
larger_2 = LargerThan(FirstNumber=trigger_button_state, SecondNumber=Slider(0, range=0..100))  # -> LargerThan, OrEqualTo
larger_3 = LargerThan(FirstNumber=current_slice_layer, SecondNumber=number_of_layers_5)  # -> LargerThan, OrEqualTo
white = ColourSwatch(SwatchColor=RGB(255, 255, 255))
black = ColourSwatch(SwatchColor=RGB(0, 0, 0))
end_of_slice_stack_boolean = Integer(larger_3.OrEqualTo)
slice_fill_light_intensity_reduction_4 = Panel(slice_fill_light_intensity_reduction_3)
filter_4 = StreamFilter(Gate=end_of_slice_stack_boolean, Stream0=white, Stream1=black)
reset_counter_boolean = Integer(reset_count_values)
expose_slice_boolean = Integer(larger_2.LargerThan)
reduced_exposure_from_this_slice_number_3 = Panel(reduced_exposure_from_this_slice_number_2)
filter_5 = StreamFilter(Gate=reset_counter_boolean, Stream0=filter_4, Stream1=black)
filter_6 = StreamFilter(Gate=expose_slice_boolean, Stream0=black, Stream1=filter_5)
larger_4 = LargerThan(FirstNumber=current_slice_layer, SecondNumber=reduced_exposure_from_this_slice_number_3)  # -> LargerThan, OrEqualTo
multiplication_3 = Multiplication(A=filter_6, B=slice_fill_light_intensity_reduction_4)
filter_7 = StreamFilter(Gate=larger_4.LargerThan, Stream0=filter_6, Stream1=multiplication_3)
material = CreateMaterial(Diffuse=filter_6, Specular=filter_6, Emission=filter_6, Transparency=0, Shine=0)
material_2 = CreateMaterial(Diffuse=filter_7, Specular=filter_7, Emission=filter_7, Transparency=0, Shine=0)
expose_slice_edges_3 = Panel(expose_slice_edges_2)
filter_8 = StreamFilter(Gate=expose_slice_edges_3, Stream1=material)

# ---- group: Pick and orient print slice
current_slice_layer_2 = Panel(filter_3)
print_center_psotion_tweak_x = Panel("0")
print_center_psotion_tweak_x_2 = Panel("0")
item_5 = ListItem(List=flip, Index=current_slice_layer_2, Wrap=True)
item_6 = ListItem(List=pln, Index=current_slice_layer_2, Wrap=True)
pt_5 = ConstructPoint(XCoordinate=print_center_psotion_tweak_x_2, YCoordinate=print_center_psotion_tweak_x, ZCoordinate=0)
flatten_4 = FlattenTree(Tree=item_5, Path="{0}")
xy_2 = XYPlane(Origin=pt_5)
orient = Orient(Geometry=flatten_4, Source=item_6, Target=xy_2)  # -> Geometry, Transform
geo = Geometry(orient.Geometry)

# ---- group: 3D preview
number_of_layers_6 = Panel(number_of_layers)
build_chamber_size_x_3 = Panel(build_chamber_size_x_2)
build_chamber_size_y_3 = Panel(build_chamber_size_y_2)
build_slice_and_3d_preview_spacing_3 = Panel(build_slice_and_3d_preview_spacing_2)
_3d_previe_display_angle_2 = Panel(_3d_previe_display_angle)
current_slice_layer_3 = Panel(filter_3)
swatch = ColourSwatch(SwatchColor=RGB(0, 221, 255))
material_3 = CreateMaterial(Diffuse=swatch, Specular=swatch, Emission=swatch, Transparency=0, Shine=0)
material_4 = CreateMaterial(
    Diffuse=ColourSwatch(SwatchColor=RGB(255, 255, 255)),
    Specular=RGB(255, 255, 255),
    Emission=RGB(0, 0, 0),
    Transparency=Slider(0.875, range=0..1),
    Shine=0)
addition_2 = Addition(A=build_chamber_size_x_3, B=build_slice_and_3d_preview_spacing_3)
multiplication_4 = Multiplication(A=build_chamber_size_y_3, B=Slider(0.1, range=0..1))
neg_3 = Negative(Value=addition_2)
neg_4 = Negative(Value=multiplication_4)
multiplication_5 = Multiplication(A=build_chamber_size_x_3, B=Slider(0.65, range=0..1))
addition_3 = Addition(A=_3d_previe_display_angle_2, B=Slider(270, range=0..1000))
pt_6 = ConstructPoint(XCoordinate=neg_3, YCoordinate=neg_4, ZCoordinate=0)
neg_5 = Negative(Value=multiplication_5)
rad = Radians(Degrees=addition_3)
X = UnitX(Factor=1)
xy_3 = XYPlane(Origin=pt_6)
division_3 = Division(A=current_slice_layer_3, B=number_of_layers_6)
addition_4 = Addition(A=neg_3, B=neg_5)
rot3d = Rotate3D(Geometry=xy_3, Angle=rad, Center=pt_6, Axis=X)  # -> Geometry, Transform
pln_2 = Plane(xy)
multiplication_6 = Multiplication(A=division_3, B=Slider(100, range=0..100))
pt_7 = ConstructPoint(XCoordinate=addition_4, YCoordinate=neg_4, ZCoordinate=0)
int_14 = Integer(multiplication_6)
orient_2 = Orient(Geometry=flip, Source=pln_2, Target=rot3d.Geometry)  # -> Geometry, Transform
number_slider_2 = Slider(2.7, range=0..10)
join_11 = TextJoin(Text=[int_14, "%"])
merge_3 = Merge(Data1="Progress:", Data2=join_11)
multiplication_7 = Multiplication(A=number_slider_2, B=Slider(1, range=0..10))
dup_9 = DuplicateData(Data=material_4, Number=number_of_layers_6, Order=True)
Y_3 = UnitY(Factor=multiplication_7)
replace = ReplaceItems(List=dup_9, Item=material_3, Indices=current_slice_layer_3, Wrap=False)
flip_2 = FlipMatrix(Data=orient_2.Geometry)
xy_4 = XYPlane(Origin=pt_7)
move_2 = Move(Geometry=pt_7, Motion=Y_3)  # -> Geometry, Transform
tag = TextTag3D(
    Location=[move_2.Geometry, xy_4],
    Text=merge_3,
    Size=[Slider(1, range=0..10), number_slider_2],
    Colour=swatch,
    Justification=1)
preview_2 = CustomPreview(Geometry=flip_2, Shader=graft(replace))

# ---- group: Slice output
geo_2 = Geometry(geo)
medges = MeshEdges(Mesh=geo_2)  # -> NakedEdges, InteriorEdges, NonManifoldEdges
preview_3 = CustomPreview(Geometry=geo_2, Shader=material_2)
preview_4 = CustomPreview(Geometry=medges.NakedEdges, Shader=filter_8)
